% Simulink data dictionary BMS_Software_DD_NXP.sldd
% references Shared_DD.sldd
% references DD_CAN_TX_RX.sldd

BMS_Sw_CodeGenConfig_NXP = Simulink.ConfigSet(StartTime="0", StopTime="10", Solver="FixedStepDiscrete", ProdHWDeviceType="ARM Compatible->ARM Cortex", SystemTargetFile="mbd_s32k.tlc", TargetLang="C")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
Sig = Simulink.Signal()
Sig1 = Simulink.Signal()
LockOCVTable = Simulink.Signal(DataType="uint8", InitialValue="0")
PreviousSOC = Simulink.Signal(DataType="uint8")
MaxCellVoltage = Simulink.Signal(DataType="single")
MinCellVoltage = Simulink.Signal(DataType="single")
MaxCellTemp = Simulink.Signal(DataType="single")
MinCellTemp = Simulink.Signal(DataType="single")
MaxTempNumber = Simulink.Signal(DataType="uint8")
MinTempNumber = Simulink.Signal(DataType="uint8")
BMS_ID_Condition = Simulink.Signal(DataType="boolean")
BMS_Status_Condition = Simulink.Signal(DataType="boolean")
Real_Time_Packets_Condition = Simulink.Signal(DataType="boolean")